# Grasshopper definition rnd_node.gh (Grasshopper 1.0.7)

lang = Slider(300, range=0..1000)
shelfheight = Slider(300, range=0..500)
number_slider = Slider(0.1, range=0..0.1)
xz_plane = XZPlane(Origin=Point(0, 0, 0))
radius = GetNumber(lang, AtLeast=1, AtMost=1, Maximum=1.797693135e+308, Minimum=-1.797693135e+308)
count = GetNumber(shelfheight, AtLeast=1, AtMost=1, Maximum=1.797693135e+308, Minimum=-1.797693135e+308)
multiplication = Multiplication(A=count, B=number_slider)
multiplication_2 = Multiplication(A=radius, B=number_slider)
plane_surface = PlaneSurface(Plane=xz_plane, XSize=radius, YSize=count)
divide_surface = DivideSurface(Surface=plane_surface, UCount=multiplication_2, VCount=multiplication)  # -> Points, Normals, Parameters
deconstruct = Deconstruct(Point=divide_surface.Points)  # -> XComponent, YComponent, ZComponent
style = GetNumber(Slider(0.1, range=-0.6..0.4), AtLeast=1, AtMost=1, Maximum=1.797693135e+308, Minimum=-1.797693135e+308)
division = Division(A=deconstruct.XComponent, B=style)
division_2 = Division(A=deconstruct.ZComponent, B=style)
material_thickness = Slider(30, range=0..100)
sine = Sine(Value=division)
cosine = Cosine(Value=division_2)
multiplication_3 = Multiplication(A=sine, B=cosine)
multiplication_4 = Multiplication(A=multiplication_3, B=Slider(15, range=10..25))
addition = Addition(A=multiplication_4, B=material_thickness)
negative = Negative(Value=addition)
construct_point = ConstructPoint(XCoordinate=deconstruct.XComponent, YCoordinate=negative, ZCoordinate=deconstruct.ZComponent)
construct_point_2 = ConstructPoint(XCoordinate=deconstruct.XComponent, YCoordinate=negative, ZCoordinate=deconstruct.ZComponent)
surface_from_points = SurfaceFromPoints(Points=flatten(construct_point), UCount=expr("x+1", multiplication_2), Interpolate=False)
project = Project(Geometry=surface_from_points, Plane=xz_plane)  # -> Geometry, Transform
curve = Curve(surface_from_points)
weave = Weave(Pattern=[0, 1], Stream0=curve, Stream1=project.Geometry, NullGaps=False)
loft = Loft(Curves=weave, Options={Adjust=False, Closed=False, LoftEnds=0, LoftSimp=0, LoftType=0, Rebuild=10, Refit=0.01})
merge = Merge(Data1=plane_surface, Data2=loft, Data3=surface_from_points)
number_slider_2 = Slider(20, range=0..100)
brep_join = BrepJoin(Breps=merge)  # -> Breps, Closed
# evaluation - user keys
unit_z = UnitZ(Factor=1)
unit_x = UnitX(Factor=1)
contour = Contour(Shape=brep_join.Breps, Point=Point(0, 0, 0), Direction=unit_x, Distance=number_slider_2)  # -> flatten(Contours)
contour_2 = Contour(Shape=brep_join.Breps, Point=Point(0, 0, 0), Direction=unit_z, Distance=number_slider_2)  # -> flatten(Contours)
number_slider_3 = Slider(2.5, range=0..10)

number_slider_4 = Slider(0, range=0..100)
cull_index = CullIndex(List=contour, Indices=number_slider_4, Wrap=True)  # -> reverse(List)
cull_index_2 = CullIndex(List=cull_index, Indices=number_slider_4, Wrap=True)

number_slider_5 = Slider(0, range=0..100)
cull_index_3 = CullIndex(List=contour_2, Indices=number_slider_5, Wrap=True)  # -> reverse(List)
cull_index_4 = CullIndex(List=cull_index_3, Indices=number_slider_5, Wrap=True)

unit_x_2 = UnitX(Factor=number_slider_3)
move = Move(Geometry=cull_index_2, Motion=unit_x_2)  # -> Geometry, Transform
unit_z_2 = UnitZ(Factor=number_slider_3)
move_2 = Move(Geometry=cull_index_4, Motion=unit_z_2)  # -> Geometry, Transform
negative_2 = Negative(Value=unit_x_2)
surface = Surface(move.Geometry)
negative_3 = Negative(Value=unit_z_2)
surface_2 = Surface(move_2.Geometry)
extrude = Extrude(Base=surface, Direction=negative_2)
curve_2 = Curve(surface_2)
extrude_2 = Extrude(Base=surface_2, Direction=negative_3)
curve_3 = Curve(surface)

# ----
# colour
curvepoint = PointOnCurve([curve_3, curve_2], parameter=0.125)
pt = ConstructPoint(XCoordinate=0, YCoordinate=0, ZCoordinate=0)
pull = PullPoint(Point=curvepoint, Geometry=pt, ClosestOnly=True)  # -> ClosestPoint, Distance
bnd = Bounds(Numbers=pull.Distance)
remap = RemapNumbers(Value=pull.Distance, Source=bnd, Target=Domain(0, 1))  # -> Mapped, Clipped
gradient = Gradient(LowerLimit=0, UpperLimit=1, Parameter=remap.Mapped, stops=[0: RGB(0, 128, 0), 0.5: RGB(255, 255, 0), 1: RGB(255, 0, 0)])

area = Area(Geometry=[surface, surface_2])  # -> Area, Centroid
length = Length(Curve=curve_3)
mass_addition = MassAddition(Input=length)  # -> Result, PartialResults
mass_addition_2 = MassAddition(Input=area.Area)  # -> Result, PartialResults
division_3 = Division(A=mass_addition.Result, B="2400")
multiplication_5 = Multiplication(A=division_3, B="100")
multiplication_6 = Multiplication(A=mass_addition_2.Result, B="0.0001")
multiplication_7 = Multiplication(A=multiplication_6, B="36")
addition_2 = Addition(A=multiplication_5, B=multiplication_7)

# ---- group: RH_OUT:mesh
mesh = Mesh([extrude_2, extrude])

# ----
multiplication_8 = Multiplication(A=addition_2, B="2")
format = Format(Format="{0:0.00}", Culture=127, Data0=multiplication_8)
c_script = CSharpScript(crv=[curve_3, curve_2], color=gradient, cost=format)  # -> out, A; inputs crv: Curve, color: Color, cost: String
# ---------- c_script: C# ----------
    var c = color.R + "," + color.G + "," + color.B;
    crv.SetUserString("color", c);
        crv.SetUserString("cost", cost);
    A = crv;
# ---------- end c_script ----------

# ---- group: RH_OUT:preferences
curve_4 = Curve(flatten(c_script.A))
